# Grasshopper definition DTS_Section J_NCC19.gh (Grasshopper 1.0.7)

# ----
# 2 Select Climate Zone
number_slider = Slider(6, range=1..8)

# ----
# Space Dimentions
roomlenght = Slider(36, range=0..100)
roomwidth = Slider(21, range=0..100)
roomheight = Slider(4, range=0..10)

# ----
# Window
proofilethicknes = Slider(0.01, range=0..0.01)
profilewidth = Slider(0.1, range=0..1)
profiledepth = Slider(0.1, range=0..1)
glasspanelwidth = Slider(1.5, range=0..10)
panelheight = Slider(2, range=0..10)

# ----
# Shading
number_slider_2 = Slider(0.5, range=0..1)
number_slider_3 = Slider(1, range=0..5)

# ----
# Inputs
number_slider_4 = Slider(0.8, range=0..1)

# ----
# WWR
number_slider_5 = Slider(0.5, range=0..1)

# ----
# Materials
frameuv = Slider(20, range=1..50)
paneluv = Slider(2, range=1..5)
soliduv = Slider(0.5, range=0..1)
shgc = Slider(0.23, range=0..1)

# ----
# 3 Select NCC Building Class
building_class = Panel("""Class 2 Common Area
Class 3 Hotel
Class 5 building
Class 6 Shop/Shopping Centre
Class 6 Restautant/Cafe
Class 7 warehouse
Class 8 Labs
Class 9a Ward
Class 9a clinic
Class 9b Theather/Cinema
Class 9b Conference Facility
Class 9b School""")
buildingclass = Slider(2, range=0..11)
class = ListItem(List=building_class, Index=buildingclass, Wrap=True)
panel = Panel(class)

# ----
# 1 Set Rhino Units to Meters
# Select Climate Zone
# WARNING
# For climate zone 8 - check SHGS
# requirements for non wards
# - differ per orientation
# 
# For climate zone 1 - check SHGC
# requirements for wards
# - differ per orientation
panel_2 = Panel("""Climate Zone
1 Darwin
2 Brisbane
3 Alice Spring
4 Albury
5 Sydney
6 Melbourne
7 Canberra
8 Central Highlands Tasmania""")
item = ListItem(List=panel_2, Index=number_slider, Wrap=True)
panel_3 = Panel(item)
climatezone = Number(number_slider)
ghpython_script = GhPythonScript(x=climatezone, y=class)  # -> MaxUvt
# ---------- ghpython_script: Python ----------
"""Provides a scripting component. NCC 19. J1.5(a) (page 359)
    Inputs:
        x: The Climate zone script variable
        y: The Building type script variable
    Output:
        a: The max Total U value output variable"""

__author__ = "BOG94192"
__version__ = "2020.10.14"


import rhinoscriptsyntax as rs

type = y
climate = x

def Uvalue(type, climate):
    i = ["Class 2 Common Area", "Class 5 building", "Class 6 Shop/Shopping Centre", 
    "Class 6 Restautant/Cafe", "Class 7 warehouse", "Class 8 Labs", 
    "Class 9b Theather/Cinema", "Class 9b Conference Facility", "Class 9b School"]
    ii = ["Class 3 Hotel", "Class 9a Ward", "Class 9a clinic"]
    
    if type in i:
        result = 2.0
        
    elif type in ii:
        c = [1, 3, 4, 6, 7]
        if climate == 2 or climate == 5:
            result = 2.0
            
        elif climate in c:
            result = 1.1
            
        elif climate == 8:
            result = 0.9

    return result

print Uvalue(type, climate)
# ---------- end ghpython_script ----------
python_script = PythonScript(x=climatezone, y=class)  # -> Min_Wall_Total_Rv
# ---------- python_script: Python ----------
"""Provides a scripting component. Minimum wall Total R-value - wall area 80% or more of wall-glazing construction area
NCC 19. J1.5(a) (page 360)
    Inputs:
        x: The Climate zone script variable
        y: The Building class script variable
    Output:
        a: The max Total U value output variable"""

i = ["Class 2 Common Area", "Class 5 building", "Class 6 Shop/Shopping Centre", 
"Class 6 Restautant/Cafe", "Class 7 warehouse", "Class 8 Labs", "Class 9a clinic", 
"Class 9b Theather/Cinema", "Class 9b Conference Facility", "Class 9b School"]

ii = ["Class 3 Hotel", "Class 9a Ward"]

if y in i:
    if x == 1:
        print (2.4)
    else:
        print (1.4)
    
elif y in ii:
    if x == 1 or x == 3:
        print (3.3)
    elif x == 2 or x == 5:
        print (1.4)
    elif x == 4 or x == 6 or x == 7:
        print (2.8)
    elif x == 8.0:
        print (3.8)
# ---------- end python_script ----------
python_script_2 = PythonScript(x=climatezone, y=class)  # -> Max_WG_SHGC
# ---------- python_script_2: Python ----------
"""Provides a scripting component. Maximum wall-glazing construction solar admittance
NCC 19. J1.5(b) (page 360)
    Inputs:
        x: The Climate zone script variable
        y: The Building class script variable
    Output:
        a: The max Total U value output variable"""

j15b = ["Class 2 Common Area", "Class 5 building", "Class 6 Shop/Shopping Centre", 
"Class 6 Restautant/Cafe", "Class 7 warehouse", "Class 8 Labs", "Class 9a clinic", 
"Class 9b Theather/Cinema", "Class 9b Conference Facility", "Class 9b School"]

j15c = ["Class 3 Hotel", "Class 9a Ward"]

if y in j15b:
    if x == 1.0:
        print ("0.12")
    elif x == 2.0 or x == 4.0 or x == 5.0 or x == 6.0 or x == 7.0:
        print ("0.13")
    elif x == 3.0:
        print ("0.16")
    elif x == 8.0:
        print ("E=0.2_N=0.2_S=0.42_W=0.36")
    
elif y in j15c:
    if x == 1.0:
        print ("E0.07_N0.7_S0.10_W0.07")
    elif x == 2.0 or x == 5.0:
        print ("0.1")
    elif x == 3.0 or x == 4.0 or x == 6.0:
        print ("0.07")
    elif x == 7.0:
        print ("E0.07_N0.07_S0.08_W0.07")
    elif x == 8.0:
        print ("0.08")
# ---------- end python_script_2 ----------

# ----
# Geometry
cluster = Cluster_2(
    F=roomheight,
    X=roomwidth,
    Y=roomlenght,
    A=roomwidth,
    B=roomlenght,
    north=Slider(0.5, range=0..1),
    east=number_slider_5,
    south=Slider(0.5, range=0..1),
    west=Slider(0.5, range=0..1),
    win_height=panelheight,
    sill_height=number_slider_4,
    depth=number_slider_2,
    shade_count=number_slider_3)
# Min DTS Values
panel_4 = Panel([python_script, ghpython_script, python_script_2])

# ----
# Review Geo/Values
facesbytype = HBFacesByType(hb_objs=cluster)  # -> walls, interior_walls, roofs, ceilings, exterior_floors, interior_floors, air_walls, apertures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; plug-in component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
faceattr = HBFaceAttributes({"Display Name": "display_name", "Simulation Name (Identifier)": "identifier", "Boundary Condition": "boundary_condition", "Has Parent": "has_parent", "Parent": "parent", "Area": "area", "Perimeter": "perimeter", "Face Type": "type", "Aperture Is Operable": "is_operable", "Door Is Glass": "is_glass"}, selected="Area")
panel_5 = Panel(facesbytype.apertures)
faceattr_2 = HBFaceAttributes({"Display Name": "display_name", "Simulation Name (Identifier)": "identifier", "Boundary Condition": "boundary_condition", "Has Parent": "has_parent", "Parent": "parent", "Area": "area", "Perimeter": "perimeter", "Face Type": "type", "Aperture Is Operable": "is_operable", "Door Is Glass": "is_glass"}, selected="Area")
model = HBModel(rooms=flatten(cluster))  # -> report, model; plug-in component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
lablefaces = HBLabelFaces(hb_objs=flatten(facesbytype.walls), attribute=faceattr, sub_faces=Toggle(False))  # -> label_text, base_pts, labels, wire_frame; plug-in component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
lablefaces_2 = HBLabelFaces(hb_objs=flatten(facesbytype.apertures), attribute=faceattr_2, sub_faces=Toggle(True))  # -> label_text, base_pts, labels, wire_frame; plug-in component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
vizall = HBVizualizeAll(hb_objs=flatten(model.model))  # -> geo; plug-in component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
ma = MassAddition(Input=lablefaces_2.label_text)  # -> Result, PartialResults
ma_2 = MassAddition(Input=lablefaces.label_text)  # -> Result, PartialResults

# ----
# Window Uv
# With Acount for framing
cluster_2 = Cluster_4(B=frameuv, F=profiledepth, X=glasspanelwidth, Y=panelheight, x=profilewidth, B_2=paneluv)
totaluv = Panel(cluster_2)
cluster_3 = Cluster(
    A=number_slider_2,
    A_2=panelheight,
    B=number_slider_3,
    shgc_wardsproposed=shgc,
    shgc_main=python_script_2,
    hb_objs=facesbytype.apertures,
    hb_objs_2=facesbytype.walls)  # -> R, R_2, R_4, R_3
# DTS Calculator
# Total Facad Uv
cluster_4 = Cluster_3(A_2=ma.Result, B_3=cluster_2, A=ma_2.Result, B_2=ma.Result, B_4=soliduv, B=ma_2.Result, num=ghpython_script)  # -> R, R_2
larger = LargerThan(FirstNumber=cluster_4.R, SecondNumber=python_script)  # -> LargerThan, OrEqualTo
python = GhPythonScript(x=larger.LargerThan)  # -> out; same code as python_5
# Solid fabric Rv
totalfacadeuv = Panel(python)
# SHGC per orientation
shgc_2 = Panel([cluster_3.R, cluster_3.R_2, cluster_3.R_4, cluster_3.R_3])
# Total Uv
totalfacadeuv_2 = Panel(cluster_4.R_2)

# ==== cluster Cluster
A = ClusterInput()
A_2 = ClusterInput()
B = ClusterInput()
shgc_wardsproposed = ClusterInput()
shgc_main = ClusterInput()
hb_objs = ClusterInput()
hb_objs_2 = ClusterInput()
faceattr = HBFaceAttributes({"Display Name": "display_name", "Simulation Name (Identifier)": "identifier", "Boundary Condition": "boundary_condition", "Has Parent": "has_parent", "Parent": "parent", "Area": "area", "Perimeter": "perimeter", "Face Type": "type", "Aperture Is Operable": "is_operable", "Door Is Glass": "is_glass"}, selected="Area")
faceattr_2 = HBFaceAttributes({"Display Name": "display_name", "Simulation Name (Identifier)": "identifier", "Boundary Condition": "boundary_condition", "Has Parent": "has_parent", "Parent": "parent", "Area": "area", "Perimeter": "perimeter", "Face Type": "type", "Aperture Is Operable": "is_operable", "Door Is Glass": "is_glass"}, selected="Area")
lablefaces = HBLabelFaces(hb_objs=flatten(hb_objs_2), attribute=faceattr)  # -> label_text, base_pts, labels, wire_frame; plug-in component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
lablefaces_2 = HBLabelFaces(hb_objs=flatten(hb_objs), attribute=faceattr_2, sub_faces=Toggle(True))  # -> label_text, base_pts, labels, wire_frame; plug-in component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
shgc_wardsproposed_2 = Number(shgc_wardsproposed)

# ----
# Shading Factor
# P/H
division = Division(A=A_2, B=B)
number_slider = Slider(0, range=0..100)
division_2 = Division(A=A, B=division)

shgc_main_2 = Number(shgc_main)

item = ListItem(List=flatten(lablefaces_2.label_text), Index="0", Wrap=True)
python = PythonScript(x=division_2, y=number_slider, z="North")  # -> a
# ---------- python: Python ----------
"""Provides a scripting component.
    Inputs:
        x: P/H script variable
        y: G/H script variable
        z: The orientation script variable
    Output:
        a: The Shading Factor output variable"""

__author__ = "BOG94192"
__version__ = "2020.10.14"

PH = round(x, 1)

ShadingFactor = {}
ratioPH = [0.1, 0.2, 0.3, 0.4, 0.5, 0.6, 0.7, 0.8, 0.9, 1.0]

if z == "North" or z == "East" or z == "West":
    if y < 0.1:
        variable = [1, 0.9, 0.8, 0.72, 0.64, 0.57, 0.51, 0.46, 0.41, 0.38, 0.35] 

    elif y < 0.2:
        variable = [1, 0.95, 0.89, 0.81, 0.74, 0.66, 0.59, 0.51, 0.47, 0.42, 0.4] 

    elif y < 0.3:
        variable = [1, 0.98, 0.94, 0.89, 0.82, 0.75, 0.68, 0.62, 0.56, 0.51, 0.47] 

    elif y < 0.4:
        variable = [1, 1, 0.97, 0.94, 0.89, 0.84, 0.78, 0.72, 0.66, 0.61, 0.57] 

    elif y < 0.5:
        variable = [1, 1, 0.99, 0.97, 0.94, 0.90, 0.86, 0.82, 0.77, 0.73, 0.68] 

    elif y < 0.6:
        variable = [1, 1, 1, 0.99, 0.97, 0.95, 0.92, 0.90, 0.86, 0.83, 0.79] 

elif z == "South":
    if y < 0.1:
        variable = [1, 0.93, 0.87, 0.82, 0.77, 0.73, 0.69, 0.65, 0.62, 0.6, 0.58] 

    elif y < 0.2:
        variable = [1, 0.97, 0.93, 0.88, 0.84, 0.79, 0.75, 0.71, 0.67, 0.64, 0.62] 

    elif y < 0.3:
        variable = [1, 0.98, 0.96, 0.93, 0.89, 0.85, 0.81, 0.77, 0.73, 0.70, 0.68]

    elif y < 0.4:
        variable = [1, 0.99, 0.98, 0.96, 0.93, 0.90, 0.87, 0.83, 0.80, 0.77, 0.74]

    elif y < 0.5:
        variable = [1, 1, 0.99, 0.98, 0.96, 0.94, 0.91, 0.89, 0.86, 0.84, 0.81]

    elif y < 0.6:
        variable = [1, 1, 0.99, 0.99, 0.98, 0.96, 0.95, 0.93, 0.91, 0.90, 0.88]
        

for key in ratioPH:
    for value in variable:
        ShadingFactor[key] = value
        variable.remove(value)
        break
if PH == 0:
    print 1
else:
    result = ShadingFactor[PH]
    print result
# ---------- end python ----------
panel = Panel(python)
multiplication = Multiplication(A=item, B=python)
item_2 = ListItem(List=flatten(lablefaces.label_text), Index="0", Wrap=True)
multiplication_2 = Multiplication(A=multiplication, B=shgc_wardsproposed_2)
division_3 = Division(A=multiplication_2, B=item_2)

item_3 = ListItem(List=flatten(lablefaces_2.label_text), Index="2", Wrap=True)
python_2 = PythonScript(x=division_2, y=number_slider, z="South")  # -> a; same code as python
panel_2 = Panel(python_2)
multiplication_3 = Multiplication(A=item_3, B=python_2)
item_4 = ListItem(List=flatten(lablefaces.label_text), Index="2", Wrap=True)
multiplication_4 = Multiplication(A=multiplication_3, B=shgc_wardsproposed_2)
division_4 = Division(A=multiplication_4, B=item_4)

item_5 = ListItem(List=flatten(lablefaces_2.label_text), Index="1", Wrap=True)
python_3 = PythonScript(x=division_2, y=number_slider, z="East")  # -> a; same code as python
panel_3 = Panel(python_3)
multiplication_5 = Multiplication(A=item_5, B=python_3)
item_6 = ListItem(List=flatten(lablefaces.label_text), Index="1", Wrap=True)
multiplication_6 = Multiplication(A=multiplication_5, B=shgc_wardsproposed_2)
division_5 = Division(A=multiplication_6, B=item_6)

item_7 = ListItem(List=flatten(lablefaces_2.label_text), Index="3", Wrap=True)
python_4 = PythonScript(x=division_2, y=number_slider, z="West")  # -> a; same code as python
panel_4 = Panel(python_4)
multiplication_7 = Multiplication(A=item_7, B=python_4)
item_8 = ListItem(List=flatten(lablefaces.label_text), Index="3", Wrap=True)
multiplication_8 = Multiplication(A=multiplication_7, B=shgc_wardsproposed_2)
division_6 = Division(A=multiplication_8, B=item_8)

smaller = SmallerThan(FirstNumber=division_3, SecondNumber=shgc_main_2)  # -> SmallerThan, OrEqualTo
smaller_2 = SmallerThan(FirstNumber=division_5, SecondNumber=shgc_main_2)  # -> SmallerThan, OrEqualTo
smaller_3 = SmallerThan(FirstNumber=division_6, SecondNumber=shgc_main_2)  # -> SmallerThan, OrEqualTo
smaller_4 = SmallerThan(FirstNumber=division_4, SecondNumber=shgc_main_2)  # -> SmallerThan, OrEqualTo
python_5 = GhPythonScript(x=smaller.OrEqualTo)  # -> out
# ---------- python_5: Python ----------
__author__ = "BOG94192"
__version__ = "2021.03.04"

import rhinoscriptsyntax as rs

if x == True:
    print "Pass"
else:
    print "Fail"
# ---------- end python_5 ----------
python_6 = GhPythonScript(x=smaller_2.OrEqualTo)  # -> out; same code as python_5
python_7 = GhPythonScript(x=smaller_3.OrEqualTo)  # -> out; same code as python_5
python_8 = GhPythonScript(x=smaller_4.OrEqualTo)  # -> out; same code as python_5
concat = Concatenate(FragmentA=division_3, FragmentC="_", FragmentB=python_5)
R = ClusterOutput(concat)
concat_2 = Concatenate(FragmentA=division_5, FragmentC="_", FragmentB=python_6)
R_2 = ClusterOutput(concat_2)
concat_3 = Concatenate(FragmentA=division_6, FragmentC="_", FragmentB=python_7)
R_3 = ClusterOutput(concat_3)
concat_4 = Concatenate(FragmentA=division_4, FragmentC="_", FragmentB=python_8)
R_4 = ClusterOutput(concat_4)

# ==== cluster Cluster_2
depth = ClusterInput()
shade_count = ClusterInput()
win_height = ClusterInput()
sill_height = ClusterInput()
north = ClusterInput()
east = ClusterInput()
south = ClusterInput()
west = ClusterInput()
F = ClusterInput()
X = ClusterInput()
Y = ClusterInput()
A = ClusterInput()
B = ClusterInput()
rectangle = Rectangle(Plane=PlaneXY(0, 0, 0), XSize=X, YSize=Y, Radius=0)  # -> Rectangle, Length
addition = Addition(A=A, B=B)
Z = UnitZ(Factor=F)
multiplication = Multiplication(A=addition, B=2)
extr = Extrude(Base=rectangle.Rectangle, Direction=Z)
cap = CapHoles(Brep=extr)
roomsolid = HBRoomFromSolid(geo=flatten(cap), conditioned=True)  # -> report, rooms; plug-in component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
facparam = HBFacadeParameters(north=north, east=east, south=south, west=west)  # -> fac_par; plug-in component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
aperturesbyratio = HBAperturesByRatio(hb_objs=flatten(roomsolid.rooms), ratio=facparam, win_height=win_height, sill_height=sill_height)  # -> report, hb_objs; plug-in component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
louvershades = HBLouverShades(hb_objs=flatten(aperturesbyratio.hb_objs), depth=depth, shade_count=shade_count)  # -> report, hb_objs; plug-in component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
hb_objs = ClusterOutput(louvershades.hb_objs)

# ==== cluster Cluster_3
B = ClusterInput()
num = ClusterInput()
A = ClusterInput()
B_2 = ClusterInput()
A_2 = ClusterInput()
B_3 = ClusterInput()
B_4 = ClusterInput()
division = Division(A=1, B=B_4)
R = ClusterOutput(division)
addition = Addition(A=division, B=0.17)
subtraction = Subtraction(A=A, B=B_2)
division_2 = Division(A=1, B=addition)
multiplication = Multiplication(A=A_2, B=B_3)
multiplication_2 = Multiplication(A=subtraction, B=division_2)
addition_2 = Addition(A=multiplication, B=multiplication_2)
division_3 = Division(A=addition_2, B=B)
num_2 = Number(num)
smaller = SmallerThan(FirstNumber=division_3, SecondNumber=num_2)  # -> SmallerThan, OrEqualTo
python = GhPythonScript(x=smaller.OrEqualTo)  # -> out; same code as python_5
concat = Concatenate(FragmentA="Facade_Ut ", FragmentB=division_3, FragmentC="_", FragmentD=python)
R_2 = ClusterOutput(concat)

# ==== cluster Cluster_4
X = ClusterInput()
Y = ClusterInput()
x = ClusterInput()
F = ClusterInput()
B = ClusterInput()
B_2 = ClusterInput()
xz = XZPlane(Origin=Point(0, 0, 0))
rectangle = Rectangle(Plane=xz, XSize=X, YSize=Y, Radius=0)  # -> Rectangle, Length
neg = Negative(Value=x)
offset = OffsetCurve(Curve=rectangle.Rectangle, Distance=neg, Plane=xz, Corners=1)  # -> flatten(Curve)
boundary = BoundarySurfaces(Edges=rectangle.Rectangle)
boundary_2 = BoundarySurfaces(Edges=offset)
sdiff = SolidDifference(BrepsA=boundary, BrepsB=boundary_2)
area = Area(Geometry=boundary_2)  # -> Area, Centroid
area_2 = Area(Geometry=sdiff)  # -> Area, Centroid

ma = MassAddition(Input=flatten(area.Area))  # -> Result, PartialResults
ma_2 = MassAddition(Input=flatten(area_2.Area))  # -> Result, PartialResults

glass_area = Panel(ma.Result)
framing_area = Panel(ma_2.Result)
Y_2 = UnitY(Factor=F)
extr = Extrude(Base=sdiff, Direction=Y_2)
extr_2 = Extrude(Base=boundary_2, Direction=Y_2)
addition = Addition(A=ma_2.Result, B=ma.Result)
multiplication = Multiplication(A=ma.Result, B=B_2)
multiplication_2 = Multiplication(A=ma_2.Result, B=B)
addition_2 = Addition(A=multiplication_2, B=multiplication)
division = Division(A=addition_2, B=addition)
R = ClusterOutput(division)
